# Dynamo custom node 3dPreviewTextByStringOriginScale.dyf (Dynamo 2.11.1.4675)
# category: GenerativeDesign.Visualize
# Creates text in the dynamo viewport from a string, origin, scale and font family name. Also offers the option to center the text. This is useful for Generative Design Visualization.

inputText = Input(inputText: string[])  # input your text to visualize here
scale = Input(scale: int = 1)  # what size do you want this
fontFamily = Input(fontFamily: string = "Comic Sans MS")  # pick a font family. defaulted to the best font for generative design
python_script = Python(IN[0]=inputText, IN[1]=scale, IN[2]=fontFamily)  # IronPython2
# ---------- python_script.python (79 lines) ----------
# based largely on https://github.com/DynamoDS/DynamoText
# imports
import clr
clr.AddReference('ProtoGeometry')
from Autodesk.DesignScript.Geometry import Point as dsPoint, Line as dsLine, BoundingBox as dsBox
clr.AddReference('System')
from System.Collections.Generic import List
from System.Globalization import *
clr.AddReference('WindowsBase')
from System.Windows import Point
clr.AddReference('PresentationCore')
from System.Windows.Media import *
from System.Windows import FlowDirection, FontStyles, FontWeights, FontStretches

#definitions
def LineBetweenPoints(origin,scale,a,b):
	pt1 = dsPoint.ByCoordinates((a.X * scale) + origin.X, ((-a.Y + 1) * scale) + origin.Y, origin.Z)
	pt2 = dsPoint.ByCoordinates((b.X * scale) + origin.X, ((-b.Y + 1) * scale) + origin.Y, origin.Z)
	crv = dsLine.ByStartPointEndPoint(pt1, pt2)
	return crv

def GetCurves(textGeometry):
	crvs = []
	for figure in textGeometry.GetFlattenedPathGeometry().Figures:
		init = figure.StartPoint
		a = figure.StartPoint
		b = None
	
		for segment in figure.GetFlattenedPathFigure().Segments:
			lineSeg = segment
			
			if lineSeg is not None and lineSeg is LineSegment:
				 b = lineSeg.Point
				 crv = LineBetweenPoints(origin, scale, a, b)
				 a = b
				 crvs.append(crv)
			if lineSeg is not None and lineSeg.GetType().ToString	().Contains("Poly"):
				for segPt in lineSeg.Points:
					crv = LineBetweenPoints(origin, scale, a, segPt)
					a = segPt
					crvs.append(crv)
	return crvs

def FormatText(text):
	font = FontFamily(fontName)
	fontStyle = FontStyles.Normal
	fontWeight = FontWeights.Medium
	typeFace = Typeface(font,fontStyle,fontWeight,FontStretches.Normal)
	formattedText = FormattedText(text,CultureInfo.GetCultureInfo("en-us"),FlowDirection.LeftToRight,typeFace,1,Brushes.Black)
	return formattedText
	
def ExtractCenter(geos):
	box = dsBox.ByGeometry(geos)
	line = dsLine.ByStartPointEndPoint(box.MinPoint,box.MaxPoint)
	return line.PointAtParameter(0.5)
	
#outputs
crvs = []
centroids = []

#inputs
text = IN[0]
origin = dsPoint.ByCoordinates(0,0,0)
scale = IN[1]
fontName = IN[2]

if scale is None:
	scale = 1
if fontName is None:
	fontName = "Comic Sans MS"

for i in text:
	formattedText = FormatText(i)
	textGeometry = formattedText.BuildGeometry(Point(0, 0))
	instanceCurves = GetCurves(textGeometry)
	crvs.append(GetCurves(textGeometry))
	centroids.append(ExtractCenter(instanceCurves))
	
OUT = centroids,crvs
# ----------------------------------------
code_block = CodeBlock(out=python_script) { points = out[0]; curves = out[1]; }
centeredText = Input(centeredText: bool = true)  # would you like to center the text?
origin = Point.Origin()
if_ = If(test=centeredText, true=code_block.points, false=origin)
byOrigin = CoordinateSystem.ByOrigin(origin=if_, lacing=Shortest)
textLocation = Input(textLocation: var[]..[])  # the text location
byOrigin_2 = CoordinateSystem.ByOrigin(origin=textLocation, lacing=Shortest)
transform = Geometry.Transform(geometry=code_block.curves, fromCoordinateSystem=byOrigin, contextCoordinateSystem=byOrigin_2, lacing=Shortest)
textCurves = Output(transform)
