# Dynamo custom node ContrastingColorRange.dyf (Dynamo 2.10.1.3976)
# category: GenerativeDesign.Visualize
# This generates a contrasting color range with an initial value of 64 distinct colors. If the range requested exceeds that the colors will be closer to one another.

# group: Build my color range with 64 distinct colors
string = StringInput("1,0,103\",\"213,255,0\",\"255,0,86\",\"158,0,142\",\"14,76,161\",\"255,229,2\",\"0,95,57\",\"0,255,0\",\"149,0,58\",\"255,147,126\",\"164,36,0\",\"0,21,68\",\"145,208,203\",\"98,14,0\",\"107,104,130\",\"0,0,255\",\"0,125,181\",\"106,130,108\",\"0,174,126\",\"194,140,159\",\"190,153,112\",\"0,143,156\",\"95,173,78\",\"255,0,0\",\"255,0,246\",\"255,2,157\",\"104,61,59\",\"255,116,163\",\"150,138,232\",\"152,255,82\",\"167,87,64\",\"1,255,254\",\"255,238,232\",\"254,137,0\",\"189,198,255\",\"1,208,255\",\"187,136,0\",\"117,68,177\",\"165,255,210\",\"255,166,254\",\"119,77,0\",\"122,71,130\",\"38,52,0\",\"0,71,84\",\"67,0,44\",\"181,0,255\",\"255,177,103\",\"255,219,102\",\"144,251,146\",\"126,45,210\",\"189,211,147\",\"229,111,254\",\"222,255,116\",\"0,255,120\",\"0,155,255\",\"0,100,1\",\"0,118,255\",\"133,169,0\",\"0,185,23\",\"120,130,49\",\"0,255,198\",\"255,110,65\",\"232,94,190")
code_block = CodeBlock { "\",\""; ","; }
split = String.Split(str=string, separator0=code_block.out0)
split_2 = String.Split(str=split, separator0=code_block.out1)
toNumber = String.ToNumber(str=split_2)
code_block_2 = CodeBlock { 0; 1; 2; }
getItemAtIndex = List.GetItemAtIndex(list=toNumber@L2, index=code_block_2.out0)
getItemAtIndex_2 = List.GetItemAtIndex(list=toNumber@L2, index=code_block_2.out1)
getItemAtIndex_3 = List.GetItemAtIndex(list=toNumber@L2, index=code_block_2.out2)
byARGB = Color.ByARGB(r=getItemAtIndex, g=getItemAtIndex_2, b=getItemAtIndex_3)

count = List.Count(list=byARGB)
code_block_3 = CodeBlock(colors=count) { 0..1..#colors; }
numberOfColors = Input(numberOfColors: int = 10)
max = Math.Max(value1=count, value2=numberOfColors)
code_block_4 = CodeBlock(colors=max) { 0..1..#colors; }
color_range = ColorRange(colors=byARGB, indices=code_block_3, value=code_block_4)
takeItems = List.TakeItems(list=color_range, amount=numberOfColors)
colors = Output(takeItems)
