# Dynamo custom node SmileyByOriginAndValue.dyf (Dynamo 2.10.1.3976)
# category: GenerativeDesign.Visualize
# This will generate a smiley face or frowny face based on the radius, input value and origin. Useful for generative workflows that need scoring in a neater way.

origin = Input(origin: Autodesk.DesignScript.Geometry.Point = Autodesk.DesignScript.Geometry.Point.Origin())
radius = Input(radius: double = 2)

# group: Build inner and outer circle
code_block = CodeBlock(radius=radius) { [radius,radius/1.5]; }
byCenterPointRadius = Circle.ByCenterPointRadius(centerPoint=origin, radius=code_block)
code_block_2 = CodeBlock(x=byCenterPointRadius) { x[0]; x[1]; }

# group: Render smiley background
byPatch = Surface.ByPatch(closedCurve=code_block_2.out0)
color_palette = ColorPalette({R: 255, G: 255, B: 0, A: 138})
byGeometryColor = Modifiers.GeometryColor.ByGeometryColor(geometry=byPatch, color=color_palette)

# group: Host lines
centerPoint = Circle.CenterPoint(circle=code_block_2.out0)
code_block_3 = CodeBlock { 0.75; }
pointAtParameter = Curve.PointAtParameter(curve=code_block_2.out0, param=code_block_3)

# group: Build smile and eye parameters
code_block_4 = CodeBlock { [-1,1]; [0.25,-0.75]; }
translate = Geometry.Translate(geometry=centerPoint, xTranslation=code_block_4.out0, yTranslation=code_block_4.out1@L1)
closestPointTo = Geometry.ClosestPointTo(geometry=code_block_2.out1, other=translate)
code_block_5 = CodeBlock(x=closestPointTo) { x[0]; x[1]; }

# group: Initial Eyes
YAxis = Vector.YAxis()
code_block_6 = CodeBlock(rad=radius) { rad*(3/8); }
byStartPointDirectionLength = Line.ByStartPointDirectionLength(startPoint=code_block_5.out0, direction=YAxis, length=code_block_6)

minValue = Input(minValue: double = 0)  # this is the potential minimum of your input
maxValue = Input(maxValue: double = 1)  # this is the potential maximum of your input
inputValue = Input(inputValue: double = 0)

# group: Remap the input parameters to allow for smile (0) and frown (1)
code_block_7 = CodeBlock { 0; 1; 0; 45; }
mapTo = Math.MapTo(rangeMin=minValue, rangeMax=maxValue, inputValue=inputValue, targetRangeMin=code_block_7.out2, targetRangeMax=code_block_7.out3)
mapTo_2 = Math.MapTo(rangeMin=minValue, rangeMax=maxValue, inputValue=inputValue, targetRangeMin=code_block_7.out2, targetRangeMax=code_block_7.out1)

# group: Rotate eyes based on data
code_block_8 = CodeBlock { 0.5; }
pointAtParameter_2 = Curve.PointAtParameter(curve=byStartPointDirectionLength, param=code_block_8)
ZAxis = Vector.ZAxis()
code_block_9 = CodeBlock(x=mapTo) { [x*-1,x*1]; }
rotate = Geometry.Rotate(geometry=byStartPointDirectionLength, origin=pointAtParameter_2, axis=ZAxis, degrees=code_block_9)

# group: Smile arc
byStartPointEndPoint = Line.ByStartPointEndPoint(startPoint=pointAtParameter, endPoint=centerPoint)
code_block_10 = CodeBlock { [0.2,0.9]; }
trimSegmentsByParameter = Curve.TrimSegmentsByParameter(curve=byStartPointEndPoint, parameters=code_block_10)
pointAtParameter_3 = Curve.PointAtParameter(curve=trimSegmentsByParameter, param=mapTo_2)

list_create = List.Create(item0=code_block_5.out1, item1=pointAtParameter_3)

# group: Smile or frown
flatten = List.Flatten(list=list_create)
byBestFitThroughPoints = Arc.ByBestFitThroughPoints(points=flatten)

# group: Output
list_create_2 = List.Create(item0=rotate, item1=byBestFitThroughPoints, item2=code_block_2.out0)

flatten_2 = List.Flatten(list=list_create_2)
color_palette_2 = ColorPalette({R: 0, G: 0, B: 0, A: 255})
byGeometryColor_2 = Modifiers.GeometryColor.ByGeometryColor(geometry=flatten_2, color=color_palette_2)
list_create_3 = List.Create(item0=byGeometryColor, item1=byGeometryColor_2)
flatten_3 = List.Flatten(list=list_create_3)
smiley = Output(flatten_3)
